# Grasshopper definition crv de nivel.gh (Grasshopper 0.9.75)

number_slider = Slider(10, range=0..10)
crv = Curve([<curve referenced from the Rhino model> x11])
addition = Addition(A=number_slider, B=Slider(1, range=0..1))
item = ListItem(List=crv, Index=number_slider, Wrap=True)
branch = TreeBranch(MaintainPaths=True)
Z = UnitZ(Factor=addition)
move = Move(Geometry=item, Motion=Z)  # -> Geometry, Transform
index = ItemIndex()
expression = Expression(Expression="If(x=0, 1, 0)")
eval = Evaluate(F="If(x≤3, 1, 0) and  If(y≥2.1, 1, 0)", x=index, y=index)
