# Grasshopper definition voronoid 3d con y una surface de gner8.gh (Grasshopper 0.9.75)
# plug-ins: Weaverbird

number_slider = Slider(20, range=0..100)
cluster = Cluster_2()
box = CenterBox(Base=PlaneXY(0, 0, 0), X=number_slider, Y=number_slider, Z=number_slider)
pop3d = Populate3D(Region=cluster, Count=Slider(300, range=0..1000), Seed=Slider(19, range=0..100))
item = ListItem(List=pop3d, Index=0, Wrap=True)  # -> Item, Item1, Item2, Item3
nurbs = NurbsCurve(Vertices=[item.Item3, item.Item, item.Item1, item.Item2], Degree=3, Periodic=False)  # -> Curve, Length, Domain
voronoi³ = Voronoi3D(Points=pop3d, Box=cluster)  # -> Cells, Boundary
crv_cp = CurveClosestPoint(Point=pop3d, Curve=nurbs.Curve)  # -> Point, Parameter, Distance
smaller = SmallerThan(FirstNumber=crv_cp.Distance, SecondNumber=Slider(2.1, range=0..10))  # -> SmallerThan, OrEqualTo
cull = CullPattern(List=voronoi³.Cells, CullPattern=smaller.SmallerThan)
cluster_2 = Cluster(B=cull)
mesh = Mesh(cluster_2)
wbframe = WeaverbirdsPictureFrame(MeshPolylines=mesh, Distance=5, InsetType=0)

# ==== cluster Cluster
B = ClusterInput()
sunion = SolidUnion(Breps=B)
R = ClusterOutput(sunion)

# ==== cluster Cluster_2
srf = Surface(<surface referenced from the Rhino model>)
srf_2 = ClusterOutput(srf)
